# Grasshopper definition analyse-mesh.ghx (Grasshopper 1.0.7)

# conda activate {environment}
# conda install compas==0.15.6
# pip install git+https://github.com/tetov/overalls.git@v0.1.3
# python -m overalls.install
number_slider = Slider(6, range=0..10)
mesh = Mesh(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)
python = GhPythonScript(
    mesh=mesh,
    max_degree=number_slider,
    min_edge_length=Slider(300, range=0..1000),
    max_edge_length=Slider(1874, range=0..5000),
    min_edge_angle=Slider(30, range=0..100))  # -> out, wrong_degree, wrong_angle, wrong_edge_length; inputs max_degree: Int32
# ---------- python: Python ----------
from math import radians

from ghpythonlib.treehelpers import tree_to_list

from compas_rhino.geometry import RhinoMesh
from compas_ghpython.artists import MeshArtist

from overalls.space_frame import SpaceFrameMesh

# get compas mesh from rhino mesh
mesh = RhinoMesh.from_geometry(mesh).to_compas(cls=SpaceFrameMesh)

if min_edge_angle:
    min_edge_angle = radians(min_edge_angle)

edge_length_domain = (min_edge_length, max_edge_length)

wrong_degree, wrong_angle, wrong_edge_length = mesh.analyse_mesh_rg(
    max_degree=max_degree,
    edge_length_domain=edge_length_domain,
    min_angle=min_edge_angle)
# ---------- end python ----------
bang = Button()
unload = PythonScript(bang=bang, module="overalls")
# ---------- unload: Python ----------
import sys

def unload_modules(top_level_module_name):
    """Unloads all modules named starting with the specified string.

    This function eases the development workflow when editing a library that is
    used from Rhino/Grasshopper.

    Args:
        top_level_module_name (:obj:`str`): Name of the top-level module to unload.

    Returns:
        list: List of unloaded module names.
    """
    modules = filter(lambda m: m.startswith(top_level_module_name), sys.modules)

    for module in modules:
        sys.modules.pop(module)

    return modules

unload_modules(module)
# ---------- end unload ----------
line = Line(python.wrong_edge_length)
pt = Point(python.wrong_angle)
pt_2 = Point(python.wrong_degree)
