# Grasshopper definition subdivide.ghx (Grasshopper 1.0.7)
# plug-ins: Bifocals

# ----
# conda activate {environment}
# conda install compas==0.15.6
# pip install git+https://github.com/tetov/overalls.git@v0.1.2
# python -m overalls.install
# Test meshes
number_slider = Slider(4000, range=0..10000)
neg = Negative(Value=number_slider)
number_slider_2 = Slider(10, range=0..10)
dom = ConstructDomain(DomainStart=neg, DomainEnd=number_slider)
rectangle = Rectangle(Plane=PlaneXY(0, 0, 0), XSize=dom, YSize=dom, Radius=0)  # -> Rectangle, Length
mplane = MeshPlane(Boundary=rectangle.Rectangle, WidthCount=number_slider_2, HeightCount=number_slider_2)  # -> Mesh, Area
tri = Triangulate(Mesh=mplane.Mesh)  # -> Mesh, Count
mesh = Mesh(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)

# ----
# Subdiv scheme
list = ValueList({"Pyramid": 0, "Corner Edge-mid Face-center, Edge-mid": 1, "Connect Edge Mids": 2, "Split": 3, "Frame": 4}, selected="Corner Edge-mid Face-center, Edge-mid")

subdivision_iterations = Slider(2, range=0..10)

# ----
# Restrictions
maximum_number_of_members_per_node = Slider(20, range=0..20)
minimum_angle_between_members_in_degrees = Slider(10, range=0..90)
minimum_edge_length = Slider(100, range=0..1000)
maximum_edge_length = Slider(3000, range=0..10000)

# ----
# Can take list/tree for different
# parameters for iteration/parent face:
# * subdiv_scheme
# * rel_pos
# 
# Can take list for different
# parameters per iteration:
# * move_z
# rel_pos and move_z moves new vertex inserted in subdivision.
# 
# rel_pos moves it inside the face given a value within 0-1.
# Move_z takes an absolute value and moves the vertex in face normal.
toggle = BooleanToggle(True)
bang = Button()
python = GhPythonScript(
    mesh=mesh,
    n_iterations=subdivision_iterations,
    subdiv_scheme=simplify(list),
    max_degree=maximum_number_of_members_per_node,
    min_edge_length=minimum_edge_length,
    max_edge_length=maximum_edge_length,
    min_edge_angle=minimum_angle_between_members_in_degrees,
    split_tri_even=toggle)  # -> out, rhino_mesh, compas_mesh; inputs n_iterations: list of Int32, subdiv_scheme: tree of Int32, fkeys: list of Int32, max_degree: Int32, move_z: list, rel_pos: tree, split_tri_even: Boolean
# ---------- python: Python ----------
from math import radians

from ghpythonlib.treehelpers import tree_to_list

from compas_rhino.geometry import RhinoMesh
from compas_ghpython.artists import MeshArtist

from overalls.space_frame import SpaceFrameMesh

# get compas mesh from rhino mesh
mesh = RhinoMesh.from_geometry(mesh).to_compas(cls=SpaceFrameMesh)

if not fkeys:
    fkeys = list(mesh.faces())

if not n_iterations:
    n_iterations = [1]

if min_edge_angle:
    min_edge_angle = radians(min_edge_angle)

if split_tri_even is None:
    split_tri_even = True

if subdiv_scheme.BranchCount > 0:
    subdiv_scheme = tree_to_list(subdiv_scheme)
else:
    subdiv_scheme = None
if rel_pos.BranchCount > 0:
    if rel_pos.BranchCount == 1:
        rel_pos = tree_to_list(rel_pos)[0]
    else:
        rel_pos = tree_to_list(rel_pos)
else:
    rel_pos = None

if len(move_z) < 1:
    move_z = None

edge_length_domain = (min_edge_length, max_edge_length)

new_fkeys = mesh.subdiv_faces(fkeys,
                               n_iterations,
                               scheme=subdiv_scheme,
                               move_z=move_z,
                               rel_pos=rel_pos,
                               max_degree=max_degree,
                               edge_length_domain=edge_length_domain,
                               min_angle=min_edge_angle,
                               tri_split_equal=split_tri_even)

compas_mesh = mesh

# back to rhino mesh
artist = MeshArtist(mesh)
rhino_mesh = artist.draw_mesh()

rhino_mesh.UnifyNormals()

print(mesh.summary())
# ---------- end python ----------
unload = PythonScript(bang=bang, module="overalls")
# ---------- unload: Python ----------
import sys

def unload_modules(top_level_module_name):
    """Unloads all modules named starting with the specified string.

    This function eases the development workflow when editing a library that is
    used from Rhino/Grasshopper.

    Args:
        top_level_module_name (:obj:`str`): Name of the top-level module to unload.

    Returns:
        list: List of unloaded module names.
    """
    modules = filter(lambda m: m.startswith(top_level_module_name), sys.modules)

    for module in modules:
        sys.modules.pop(module)

    return modules

unload_modules(module)
# ---------- end unload ----------
mesh_2 = Mesh(python.rhino_mesh)
