# Grasshopper definition weaving.ghx (Grasshopper 1.0.7)
# plug-ins: Bifocals, Mesh Pipe

# ---- group: Parameters
number_slider = Slider(500, range=0..1000)
number_slider_2 = Slider(3000, range=0..10000)
number_slider_3 = Slider(10, range=0..30)
number_slider_4 = Slider(30, range=0..100)
number_slider_5 = Slider(5, range=0..10)
# conda activate mas-t2p2
# conda install compas==0.15.6
# pip install git+https://github.com/tetov/overalls
# python -m overalls.install
# 
# to update:
# pip install -U git+https://github.com/tetov/overalls
number_slider_6 = Slider(10, range=0..10)

# ----
line = Line([Line((-1000, 3500, 3192.295898), (-1000, 0, 3192.297852)), Line((74.42536163, 1750, 3804.148926), (-1000, 0, 3192.297852)), Line((74.42536163, 1750, 3804.148926), (-1000, 3500, 3192.295898)), Line((74.42536163, 5250, 3804.146973), (-1000, 7000, 3192.293945)), Line((-1000, 3500, 3192.295898), (-1000, 7000, 3192.293945)), Line((74.42536163, 5250, 3804.146973), (-1000, 3500, 3192.295898))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])
line_2 = Line([Line((869.5001221, 3500, 1692.295898), (869.5001221, 3955, 1692.293945)), Line((-65.24993896, 3500, 2442.295898), (869.5001221, 3500, 1692.295898)), Line((-65.24993896, 3500, 2442.295898), (869.5001221, 3955, 1692.293945)), Line((869.5001221, 3500, 1692.295898), (869.5001221, 3045, 1692.297852)), Line((-65.24993896, 3500, 2442.295898), (869.5001221, 3045, 1692.297852)), Line((-65.24993896, 3500, 2442.295898), (-65.24993896, 1522.5, 2442.297852))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])
lng = ListLength(List=line)
lng_2 = ListLength(List=line_2)
merge = Merge(Data1=line, Data2=line_2)  # -> flatten(Result)
python = GhPythonScript(top=lng, bottom=lng_2)  # -> out, dicts; inputs top: Int32, bottom: Int32
# ---------- python: Python ----------
dicts = []
for _ in range(top):
    dicts.append({"part": "top"})
for _ in range(bottom):
    dicts.append({"part": "bottom"})
# ---------- end python ----------

# ----
# Weave from lines
weave_two_meshes = GhPythonScript(
    lines=merge,
    data=python.dicts,
    min_edge_length=number_slider,
    max_edge_length=number_slider_2,
    max_degree=number_slider_3,
    min_angle=number_slider_4,
    n_search_results=number_slider_5,
    max_n_conn=number_slider_6)  # -> out, compas_network, from_mesh_lines, from_lines_lines, from_conn_lines, all_lines; inputs lines: list of Line, data: list, max_degree: Int32, min_angle: Boolean, n_search_results: Int32
# ---------- weave_two_meshes: Python ----------
from math import radians

from overalls.utils import is_in_domain

from overalls.space_frame import SpaceFrameNetwork

space_frame = SpaceFrameNetwork.from_rglines(lines, attr_dicts=data)

search_funcs = [space_frame.find_closest_node, space_frame.find_closest_nhood]
connect_funcs = [space_frame.connect_nodes]

include_start_face = True
if search_func:
    search_func = search_funcs[search_func - 1]
    if search_func == 2:
        search_func -= 1
        include_start_face = False
else:
    search_func = search_funcs[0]

if connect_func:
    connect_func = connect_funcs[connect_func - 1]
else:
    connect_func = connect_funcs[0]

length_domain = (min_edge_length, max_edge_length)
face_partners = []

nodes_origin = list(space_frame.nodes_where({"part": "top"}))
nodes_search = list(space_frame.nodes_where({"part": "bottom"}))

for node_origin in nodes_origin:
    found_nkeys = search_func(node_origin, nodes_search,
                               length_domain=length_domain,
                               include_start_node=True)

    face_partners.append((node_origin, found_nkeys))

# connection logic
for fkey_from, fkeys_to in face_partners:
    connect_func(fkey_from, fkeys_to, max_degree=max_degree, min_angle=radians(min_angle), max_n_conn=max_n_conn)

mesh_edges = space_frame.edges_where({"created_from": space_frame.FROM_MESH})
lines_edges = space_frame.edges_where({"created_from": space_frame.FROM_LINES})
conn_edges = space_frame.edges_where({"created_from": space_frame.FROM_CONN})

from_mesh_lines = space_frame.to_rglines(ekeys=mesh_edges)
from_lines_lines = space_frame.to_rglines(ekeys=lines_edges)
from_conn_lines = space_frame.to_rglines(ekeys=conn_edges)

all_lines = space_frame.to_rglines()

print(len(list(space_frame.nodes())))
print(len(list(space_frame.edges())))
# ---------- end weave_two_meshes ----------

bang = Button()
unload = PythonScript(bang=bang, module="overalls")
# ---------- unload: Python ----------
import sys

def unload_modules(top_level_module_name):
    """Unloads all modules named starting with the specified string.

    This function eases the development workflow when editing a library that is
    used from Rhino/Grasshopper.

    Args:
        top_level_module_name (:obj:`str`): Name of the top-level module to unload.

    Returns:
        list: List of unloaded module names.
    """
    modules = filter(lambda m: m.startswith(top_level_module_name), sys.modules)

    for module in modules:
        sys.modules.pop(module)

    return modules

unload_modules(module)
# ---------- end unload ----------
line_3 = Line(weave_two_meshes.from_mesh_lines)
line_4 = Line(weave_two_meshes.from_lines_lines)
line_5 = Line(weave_two_meshes.from_conn_lines)
lng_3 = ListLength(List=line_5)
panel = Panel(lng_3)
number_slider_7 = Slider(10, range=0..10)
mpipe = MeshPipe(Curve=line_4, Radius=number_slider_7, Accuracy=0.2, Rotation=0, Segments=10, Caps=2)
mpipe_2 = MeshPipe(Curve=line_5, Radius=number_slider_7, Accuracy=0.2, Rotation=0, Segments=10, Caps=2)
preview = CustomPreview(
    Geometry=mpipe_2,
    Material={diffuse=RGB(221, 160, 221), emission=RGB(66, 48, 66), shine=0.5, specular=RGB(255, 255, 255), transparency=0})
